# Grasshopper definition script_panel rotation_waffle.gh (Grasshopper 1.0.7)
# Copyright: © 2017-2022 Pierre Cuvilliers, Caitlin Mueller, Massachusetts Institute of Technology
# plug-ins: MosquitoAudio2, Firefly.X, Wombat, Bifocals, Firefly.Core

swatch = ColourSwatch(SwatchColor=RGB(255, 255, 255))
canvas_color = CanvasColor(Toggle=Toggle(True), BackgroundColor=swatch, GridColor=swatch)

panel = Panel("""{
"prompt":"Rainy day, Italian Style, Café",
"duration":5
}""")
# AI MUSIC GENERATION
python = GhPythonScript(x=panel)  # -> out, a
# ---------- python: Python ----------
__author__ = "Sajedeh"
__version__ = "2024.03.17"
# the imported libreries that are used in the script to implement different parts
import rhinoscriptsyntax as rs
import json
import sys
import os
import scriptcontext
requests = scriptcontext.sticky['requests']
# to call REST API
#-----------------------------------------------Reading Inputs
# variables that can be defined by users 
print(sys.exec_prefix)
vars = json.loads(x)
prompt = vars['prompt']
duration = vars['duration']
path = "E:\\building engineering\\Semester 4\\Adaptive Facade\\music generator\\musics\\"
##----------------------------------------------- AI
# given by server to recongnize the user and the workflow 
workflow_id = 'wkf_zR2OeyDcpTM1HO' # you need to sertup a workflow in the leapai dashboard and get the workflow id 
url = "https://api.workflows.tryleap.ai/v1/runs"
API_KEY = 'le_76b91625_wj61aJ6A7bA1y8hv0el0n0XK' #you need to get the api key from the leapai dashboard

prompt = str(prompt)
duration = int(duration)
payload = {
    "workflow_id": workflow_id,
    "input": {
        "format": "mp3",
        "music_prompt": prompt,
        "duration_in_seconds": duration
    }
}

headers = {
    "accept": "application/json",
    "content-type": "application/json",
    "X-Api-Key": API_KEY
}

serializedPayload = json.dumps(payload)
print(serializedPayload)
#
def generate_music(): # Generate music using leapai
    response = requests.post(url, data=serializedPayload, headers=headers)
    print(response.text)
    print(response.json())
    return response.json()

def getWorkflowRun(workflowRunId): # Get the status of the workflow run
    url = 'https://api.workflows.tryleap.ai/v1/runs/'+workflowRunId
    response = requests.get(url, headers=headers)
    return response.json()

##Music Download ---------------------------------------------------------------------------------
#
def download_mp3(url, save_path): # Download the generated music
    # Check if the file exists
    if os.path.exists(save_path):
        # If the file exists, remove it
        os.remove(save_path)
        print("Existing file removed",save_path)
    # Send a GET request to the URL
    response = requests.get(url)
    # Check if the request was successful
    if response.status_code == 200:
        # Open a file in binary write mode and write the content of the response to it
        with open(save_path, 'wb') as f:
            f.write(response.content)
        print("MP3 file downloaded successfully and saved as: ", save_path)
    else:
        print("Failed to download the MP3 file.")
        
#        
#        
#
if __name__ == "__main__":
    print(os.path.exists(path))
    try:
      workflow = generate_music() # Generate music using leapai
      print(workflow) # Print the workflow run details
      while True: # Check the status of the workflow run
        workflowRun = getWorkflowRun(workflow['id']) # Get the status of the workflow run using the workflow run id
        print(workflowRun) # Print the status of the workflow run
        if workflowRun['status'] == 'completed': # Check if the music generation is completed
          print('Music generated successfully') # Print the status of the music generation
          url = workflowRun['output']['generated_music'] # Get the url of the generated music when the music generation is completed
          save_path = path+'generated_music'+workflowRun['id']+'.mp3' # Set the path to save the generated music
          download_mp3(url, save_path) # Download the generated music
          break # Break the loop when the music generation is completed
        else: # If the music generation is not completed
          print('Music generation in progress ...') # Print the status of the music generation
    except Exception as e:
        print('Your Request Failed Successfully')
        print(e)
# ---------- end python ----------
pythonremote = GHPythonRemote(location="C:\Users\Sajedeh\3D Objects\anaconda3\envs\rhinoremote", run=Toggle(True), modules="requests")  # -> out, linked_modules, rpy, import_statements

path = FilePath("E:\building engineering\Semester 4\music genrated\output_06f4a6a7-f503-49ad-8841-f0218eec3c4b.mp3")
play = AudioPlay(AudioFile=path, Boolean=Toggle(False))
trigger = Trigger(Interval=10, TimerInterval=10, Target=capture)
# FREQUENCY ANALYSIS
capture = SoundCapture(TimePeriod=0.1, StartStopSoundCapture=Toggle(True))  # -> WavePressureSamplesFromLeftChannel, WavePressureSamplesFromRightChannel, Volume
rec = DataRecorder(capture.Volume, DataLimit=143, RecordData=True)
bnd = Bounds(Numbers=rec)
dom = ConstructDomain(DomainStart=Slider(0, range=0..90), DomainEnd=Slider(259, range=0..400))
remap = RemapNumbers(Value=capture.Volume, Source=bnd, Target=dom)  # -> Mapped, Clipped
graph = GraphMapper(remap.Mapped, x0=0, x1=1, y0=0, y1=1, Gx=0.3173500896, Gy=0.5134131908, container_name="Power", power=0.5808533862)

# ----
# Arduino
panel_2 = Panel(remap.Mapped)

ports_available = COMPortsAvailable()
panel_3 = Panel(ports_available)
number_slider = Slider(10, range=0..10)
open_port = OpenClosePort(OpenClosePort=Toggle(False), PortNumber=number_slider, BaudRate=115200)
panel_4 = Panel(open_port)
mega_write = MegaWrite(
    StartWritingValues=Toggle(False),
    DigitalPin2=0,
    DigitalPin3=0,
    DigitalPin4=0,
    DigitalPin5=0,
    DigitalPin6=0,
    DigitalPin7=0,
    DigitalPin8=panel_2,
    DigitalPin9=panel_2,
    DigitalPin10=0,
    DigitalPin11=0,
    DigitalPin12=0,
    DigitalPin13=0,
    DigitalPin32=0,
    DigitalPin33=0,
    DigitalPin34=0,
    DigitalPin35=0,
    DigitalPin36=0,
    DigitalPin37=0,
    DigitalPin38=0,
    DigitalPin39=0,
    DigitalPin40=0,
    DigitalPin41=0,
    DigitalPin42=0,
    DigitalPin43=0,
    DigitalPin44=0,
    DigitalPin45=0,
    DigitalPin46=0,
    DigitalPin47=0,
    DigitalPin48=0,
    DigitalPin49=0,
    DigitalPin50=0,
    DigitalPin51=0,
    DigitalPin52=0,
    DigitalPin53=0,
    PortNumber=number_slider)  # -> ArduinoOutput, StatusMessage

panel_5 = Panel(graph)

brep = Brep([<brep referenced from the Rhino model> x288])
debrep = DeconstructBrep(Brep=brep)  # -> Faces, Edges, Vertices
item = ListItem(List=debrep.Edges, Index=0, Wrap=True)  # -> Item, Item1, Item2, Item3
srf = Surface(debrep.Faces)
# FREQUENCY TO PANLE ROTATION
area = Area(Geometry=srf)  # -> Area, Centroid
crv = Curve(item.Item)
crv_2 = Curve(item.Item2)
divide = DivideCurve(Curve=crv_2, Count=10, Kinks=False)  # -> Points, Tangents, Parameters
divide_2 = DivideCurve(Curve=crv, Count="2", Kinks=False)  # -> Points, Tangents, Parameters
item_2 = ListItem(List=divide_2.Points, Index=0, Wrap=True)  # -> Item, Item1
item_3 = ListItem(List=divide.Points, Index=0, Wrap=True)  # -> Item, Item1, Item2, Item3, Item4, Item5
pl_3pt = Plane3Pt(PointA=area.Centroid, PointB=item_2.Item1, PointC=item_3.Item1)
deplane = DeconstructPlane(Plane=pl_3pt)  # -> Origin, XAxis, YAxis, ZAxis
rot3d = Rotate3D(Geometry=srf, Angle=expr("-x", degrees(panel_5)), Center=deplane.Origin, Axis=deplane.XAxis)  # -> Geometry, Transform
preview = CustomPreview(Geometry=rot3d.Geometry, Material="white")

panel_6 = Panel(mega_write.ArduinoOutput)
panel_7 = Panel(mega_write.StatusMessage)

# ==== cluster GHPythonRemote: Connects the Grasshopper Python component to an external Python instance.
python = PythonScript()  # -> default_working_dir
# ---------- python: Python ----------
from os import path
from Grasshopper.Folders import UserObjectFolders

cluster_comp = ghenv.Component.OnPingDocument().Owner
parent_doc_path = cluster_comp.OnPingDocument().FilePath

if parent_doc_path is not None:
    # Get path to parent GH document
    default_working_dir = path.abspath(path.dirname(parent_doc_path))
else:
    # Fallback to path to user objects default dir
    uo_folder = path.abspath(UserObjectFolders[0])
    if path.isdir(path.join(uo_folder, "gh-python-remote")):
        uo_folder = path.abspath(path.join(uo_folder, "gh-python-remote"))
    default_working_dir = uo_folder
# ---------- end python ----------
# GH to python remote example.
# ⓒ Pierre Cuvilliers, 2017-2022
# Released under the MIT license
# github.com/pilcru/ghpythonremote
# Runs and connects to an external python engine, and
# assigns imported modules to scriptcontext.sticky variables.
# 
# Arguments:
#       code (str): Path to the GH_to_python_sticky.py code file.
#       location (str): Path to a python executable, or to a folder
#             containing `python.exe`, or the name of a conda-created
#             virtual environment prefixed by `conda://` (`conda://env_name`).
#             If empty, finds python from your windows %PATH%.
#       run (boolean): Creates the connection, and imports new
#             modules, when turned to True. Kills the connection,
#             and deletes the references to the imports, when turned
#             to False.
#       modules (str list): List of module names to import in the
#             remote python. They will be added to the
#             scriptcontext.sticky dictionary, allowing them to be
#             reused from other python components in the same
#             Grasshopper document. Submodules (for example
#             `numpy.linalg` have to be added explicitly to this list
#             to be available later.
#       log_level (str from ['NOTSET', 'DEBUG', 'INFO', 'WARNING', 'ERROR', 'CRITICAL']):
#             Logging level to use for the local IronPython and the
#             remote python instance.
#       working_dir (str): Working directory for the remote python
#             instance.
# 
# Returns:
#       out (str): Console output with DEBUG information.
#       linked_modules (str list): list of imported module names.
#       rpy (rpyc connection object): The object representing the
#             remote Python interpreter.
location = ClusterInput()  # location (str): Path to a python executable, or to a folder containing `python.exe`, or the name of a conda-created virtual environment prefixed by `conda://` (`conda://env_name`). If empty, finds python from your windows %PATH%.
run = ClusterInput()  # run (boolean): Creates the connection, and imports new modules, when turned to True. Kills the connection,and deletes the references to the imports, when turned to False.
modules = ClusterInput()  # modules (str list): List of module names to import in the remote python. They will be added to the scriptcontext.sticky dictionary, allowing them to be reused from other python components in the same Grasshopper document. Submodules (for example `numpy.linalg` have to be added explicitly to this list to be available later.
list = ValueList({"CRITICAL", "ERROR", "WARNING", "INFO", "DEBUG", "NOTSET"}, selected="DEBUG")
panel = Panel(python)
ghpythonremote = GHPythonRemote(location=location, run=run, modules=modules, log_level=list, working_dir=panel)  # -> out, linked_modules, rpy; inputs run: Boolean, modules: list
# ---------- ghpythonremote: Python ----------
import inspect
import logging
from os import path
import sys
from time import sleep

import scriptcontext

import ghpythonremote
from ghpythonremote.connectors import GrasshopperToPythonRemote
from Grasshopper.Kernel.GH_RuntimeMessageLevel import Error, Warning

local_log_level = getattr(logging, log_level, logging.WARNING)
logger = logging.getLogger("ghpythonremote")
logger.setLevel(local_log_level)
ch = logging.StreamHandler()
ch.setLevel(local_log_level)
formatter = logging.Formatter("%(levelname)s: %(name)s:\n%(message)s")
ch.setFormatter(formatter)
logger.handlers = []
logger.addHandler(ch)
logger = logging.getLogger("ghpythonremote.GH_to_python")

ROOT = path.abspath(path.dirname(inspect.getfile(ghpythonremote)))
rpyc_server_py = path.join(ROOT, "pythonservice.py")

cluster_comp = ghenv.Component.OnPingDocument().Owner

# Set connection to CLOSED if this is the first run
# and initialize set of linked modules
try:
    remote_python_status
except NameError:
    remote_python_status = "CLOSED"
    lkd_modules = set()

# Wait for connection to connect or terminate
timer = 0
while remote_python_status == "CONNECTING" or remote_python_status == "CLOSING":
    sleep(1)
    timer += 1
    if timer == 10:
        try:
            gh2py_manager.__exit__(*sys.exc_info())
        except Exception:
            pass
        remote_python_status = "CLOSED"
        lkd_modules = set()
        message = (
            "Connection left in an inconsistent state and not returning. Reset "
            "everything."
        )
        if cluster_comp is not None:
            cluster_comp.AddRuntimeMessage(Warning, message)
        raise RuntimeError(message)

if run:
    if not remote_python_status == "OPEN":
        remote_python_status = "CONNECTING"
        gh2py_manager = GrasshopperToPythonRemote(
            rpyc_server_py,
            location=location,
            timeout=10,
            port=None,
            log_level=log_level,
            working_dir=working_dir,
        )
        gh2py = gh2py_manager.__enter__()
        remote_python_status = "OPEN"

    # Stuff that we can reach
    rpymod = gh2py.py_remote_modules  # A getter function for a named python module
    rpy = gh2py.connection  # Represents the remote instance root object
    scriptcontext.sticky["rpy"] = rpy
    # Add modules
    for mod in modules:
        try:
            scriptcontext.sticky[mod] = rpymod(mod)
            lkd_modules.add(mod)
        except ImportError:
            gh2py_manager.__exit__(*sys.exc_info())
            if cluster_comp is not None:
                cluster_comp.AddRuntimeMessage(
                    Error,
                    'Could not import module "{}" in remote Python.'.format(mod)
                )
            raise
        except EOFError:
            if cluster_comp is not None:
                cluster_comp.AddRuntimeMessage(
                    Error,
                    'Remote Python has been closed unexpectedly'
                )
            raise

elif not remote_python_status == "CLOSED":
    remote_python_status = "CLOSING"
    # Remove linked modules
    for mod in lkd_modules:
        del scriptcontext.sticky[mod]
    del scriptcontext.sticky["rpy"]
    gh2py_manager.__exit__(*sys.exc_info())
    lkd_modules = set()
    remote_python_status = "CLOSED"

# Change variable name because ghpython resets outputs to None before each run
linked_modules = lkd_modules

logger.info("GH to python connection is {}".format(remote_python_status))
# ---------- end ghpythonremote ----------
out = ClusterOutput(ghpythonremote.out)  # Console output.
linked_modules = ClusterOutput(ghpythonremote.linked_modules)  # Names of modules that were successfully added to the scriptcontext.sticky dictionary.
rpy = ClusterOutput(ghpythonremote.rpy)  # The object representing the remote python instance
python_2 = PythonScript(module_names=ghpythonremote.linked_modules)  # -> import_statements; inputs module_names: list
# ---------- python_2: Python ----------
import_statements = ["import scriptcontext as sc"]
for module_name in module_names:
    import_statements.append("{0} = sc.sticky['{0}']".format(module_name))

if len(module_names) == 0:
    import_statements = []
# ---------- end python_2 ----------
import_statements = ClusterOutput(python_2)  # Useful import statements to use the imported modules in your scripts.
